# Grasshopper definition nesting.gh (Grasshopper 1.0.7)

polygon_sides = Slider(5, range=0..10)
base_shape_fillet_radius = Slider(1.3, range=0..10)
offset = Slider(4.5, range=0..10)
radius_of_base_shape = Slider(14, range=1..100)
instances = Slider(3, range=1..10)
wall_thickness = Slider(1.5, range=0..5)

polygon = Polygon(Plane=PlaneXY(0, 0, 0), Radius=radius_of_base_shape, Segments=polygon_sides, FilletRadius=base_shape_fillet_radius)  # -> Polygon, Length
vector = Vector(Vector(0, 0, 0))
series = Series(Start=0, Step=offset, Count=instances)
linear_array = LinearArray(Geometry=polygon.Polygon, Direction=vector, Count=instances)  # -> Geometry, Transform
minimum = Minimum(A=wall_thickness, B=offset)
offset_curve = OffsetCurve(Curve=linear_array.Geometry, Distance=series, Plane=PlaneXY(0, 0, 0), Corners=1)  # -> flatten(Curve)
offset_curve_2 = OffsetCurve(Curve=offset_curve, Distance=minimum, Plane=PlaneXY(0, 0, 0), Corners=1)  # -> flatten(Curve)
merge = Merge(Data1=offset_curve, Data2=offset_curve_2)
graft_tree = GraftTree(Tree=offset_curve_2, IncludeEmptyLists=True, IncludeNullItems=True)
wall_height = Slider(14, range=0..20)
base_thickness = Slider(1.1, range=0..10)
boundary_surfaces = BoundarySurfaces(Edges=graft_tree)
boundary_surfaces_2 = BoundarySurfaces(Edges=merge)
unit_z = UnitZ(Factor=wall_height)
unit_z_2 = UnitZ(Factor=base_thickness)
extrude = Extrude(Base=boundary_surfaces_2, Direction=unit_z)  # -> graft(Extrusion)
extrude_2 = Extrude(Base=boundary_surfaces, Direction=unit_z_2)
addition = Addition(A=base_thickness, B=Slider(0.488, range=0..1))
series_2 = Series(Start=0, Step=addition, Count=instances)
merge_2 = Merge(Data1=extrude, Data2=extrude_2)
unit_z_3 = UnitZ(Factor=series_2)  # -> reverse(UnitVector)
solid_union = SolidUnion(Breps=merge_2)  # -> flatten(Result)
panel = Panel(solid_union)
panel_2 = Panel(unit_z_3)
move = Move(Geometry=solid_union, Motion=unit_z_3)  # -> Geometry, Transform
