# Grasshopper definition penclip.gh (Grasshopper 1.0.7)

polygon_edge = PolygonEdge(EdgeStart=Point(0, 0, 0), EdgeEnd=Point(12, 0, 0), PlanePoint=Point(5, 7, 0), Segments=3)  # -> Polygon, Centre, CornerRadius, EdgeRadius

fillet = Slider(1.749, range=0..2)
clip_thickness = Slider(2, range=1..4)

fillet_2 = Fillet(Curve=polygon_edge.Polygon, Radius=fillet)
strut_length = Slider(9, range=0..20)
explode = Explode(Curve=fillet_2, Recursive=True)  # -> Segments, Vertices
cull_index = CullIndex(List=explode.Segments, Indices=3, Wrap=True)
join_curves = JoinCurves(Curves=cull_index, Preserve=False)
offset_curve = OffsetCurve(Curve=join_curves, Distance=clip_thickness, Plane=PlaneXY(0, 0, 0), Corners=0)
merge = Merge(Data1=join_curves, Data2=offset_curve)  # -> flatten(Result)
unit_z = UnitZ(Factor=clip_thickness)
division = Division(A=clip_thickness, B=2)
loft = Loft(Curves=merge, Options={Adjust=False, Closed=False, LoftEnds=0, LoftSimp=0, LoftType=0, Rebuild=10, Refit=0.01})
negative = Negative(Value=division)
extrude = Extrude(Base=loft, Direction=unit_z)
construct_point = ConstructPoint(XCoordinate=0, YCoordinate=division, ZCoordinate=0)
construct_point_2 = ConstructPoint(XCoordinate=strut_length, YCoordinate=negative, ZCoordinate=0)
unit_x = UnitX(Factor=strut_length)
rotate = Rotate(Geometry=extrude, Angle=-0.5235987756, Plane=PlaneXY(0, 0, 0))  # -> Geometry, Transform
rectangle_2pt = Rectangle2Pt(Plane=PlaneXY(0, 0, 0), PointA=construct_point, PointB=construct_point_2, Radius=0)  # -> Rectangle, Length
move = Move(Geometry=rotate.Geometry, Motion=unit_x)  # -> Geometry, Transform
box_rectangle = BoxRectangle(Rectangle=rectangle_2pt.Rectangle, Height=clip_thickness)
merge_2 = Merge(Data1=move.Geometry, Data2=box_rectangle)
polar_array = PolarArray(Geometry=merge_2, Plane=PlaneXY(0, 0, 0), Count=3, Angle=6.283185307)  # -> flatten(Geometry), Transform
solid_union = SolidUnion(Breps=polar_array.Geometry)
