# Grasshopper definition parametric_lamp.gh (Grasshopper 1.0.7)

outer_wall_height = Slider(20, range=1..40)
inner_radius = Slider(10, range=5..30)
outer_radius = Slider(40, range=0..100)
stair_width = Slider(18, range=0..20)
stair_thickness = Slider(4, range=0..10)
stair_number = Slider(17, range=0..50)
addition = Addition(A=outer_radius, B=stair_thickness)
circle = Circle(Plane=PlaneXY(0, 0, 0), Radius=outer_radius)
circle_2 = Circle(Plane=PlaneXY(0, 0, 0), Radius=addition)
construct_point = ConstructPoint(XCoordinate=stair_width, YCoordinate=0, ZCoordinate=0)
construct_point_2 = ConstructPoint(XCoordinate=stair_width, YCoordinate=stair_thickness, ZCoordinate=0)
addition_2 = Addition(A=inner_radius, B=2)
merge = Merge(Data1=circle, Data2=circle_2)
circle_3 = Circle(Plane=PlaneXY(0, 0, 0), Radius=inner_radius)
circle_4 = Circle(Plane=PlaneXY(0, 0, 0), Radius=addition_2)
vector_xyz = VectorXYZ(XComponent=0, YComponent=outer_radius, ZComponent=0)  # -> Vector, Length
rectangle_3pt = Rectangle3Pt(PointA=Point(0, 0, 0), PointB=construct_point, PointC=construct_point_2)  # -> Rectangle, Length
merge_2 = Merge(Data1=circle_3, Data2=circle_4)
boundary_surfaces = BoundarySurfaces(Edges=merge)  # -> flatten(Surfaces)
move = Move(Geometry=rectangle_3pt.Rectangle, Motion=vector_xyz.Vector)  # -> Geometry, Transform
boundary_surfaces_2 = BoundarySurfaces(Edges=merge_2)  # -> flatten(Surfaces)
construct_point_3 = ConstructPoint(XCoordinate=0, YCoordinate=addition, ZCoordinate=0)
construct_point_4 = ConstructPoint(XCoordinate=1, YCoordinate=inner_radius, ZCoordinate=0)
construct_point_5 = ConstructPoint(XCoordinate=-1, YCoordinate=inner_radius, ZCoordinate=0)
polar_array = PolarArray(Geometry=move.Geometry, Plane=PlaneXY(0, 0, 0), Count=stair_number, Angle=6.283185307)  # -> Geometry, Transform
rectangle_3pt_2 = Rectangle3Pt(PointA=construct_point_5, PointB=construct_point_4, PointC=construct_point_3)  # -> Rectangle, Length
boundary_surfaces_3 = BoundarySurfaces(Edges=polar_array.Geometry)  # -> flatten(Surfaces)
unit_z = UnitZ(Factor=outer_wall_height)
merge_3 = Merge(Data1=boundary_surfaces_3, Data2=boundary_surfaces)
boundary_surfaces_4 = BoundarySurfaces(Edges=rectangle_3pt_2.Rectangle)
extrude = Extrude(Base=merge_3, Direction=unit_z)
polar_array_2 = PolarArray(Geometry=boundary_surfaces_4, Plane=PlaneXY(0, 0, 0), Count=3, Angle=6.283185307)  # -> flatten(Geometry), Transform
merge_4 = Merge(Data1=boundary_surfaces_2, Data2=polar_array_2.Geometry)
unit_z_2 = UnitZ(Factor=2)
extrude_2 = Extrude(Base=merge_4, Direction=unit_z_2)
merge_5 = Merge(Data1=extrude_2, Data2=extrude)
solid_union = SolidUnion(Breps=merge_5)
